# Dynamo custom node Make Daylight param parent vector.dyf (Dynamo 0.7.2.19034)
# category: Misc

# note: for each value we remap it within the range specified

list_of_family_instances = Input()
count = List.Count(list_of_family_instances)
rand = Math.Rand()
# note: this selects a random item from a list...this is useful for changing a random family instance
mul = count * rand  # lacing=Longest
floor = Math.Floor(mul)
getItemAtIndex = List.GetItemAtIndex(list_of_family_instances, floor)
list_of_parameters_and_ranges = Input()
number = DoubleInput(0)
number_2 = DoubleInput(1)
# note: remap the value into the range
remapVal = Custom[RemapVal](in_min=number, in_max=number_2)
number_3 = DoubleInput(0)
getItemAtIndex_2 = List.GetItemAtIndex(arg1=number_3)
# note: extract the ranges
map = List.Map(list_of_parameters_and_ranges, getItemAtIndex_2)
count_2 = List.Count(map)
randomList = Math.RandomList(count_2)
watch = Watch(map)
# note: get each range and generate a ranndom number from 0 to 1
transpose = List.Transpose(watch)
code_block = CodeBlock(x=transpose) { x[0]; x[1]; }
# note: add it the the start of the list of each range
combine = List.Combine(remapVal, randomList, code_block.out0, code_block.out1)
python_script = Python(IN[0]=list_of_parameters_and_ranges, IN[1]=combine)
# ---------- python_script.python (9 lines) ----------
#The input to this node will be stored in the IN[0]...INX variable(s).
paramVector = IN[0]
randomNums = IN[1]

for idx, num in enumerate(randomNums):
	paramVector[idx][0] = num

#Assign your output to the OUT variable
OUT = paramVector
# ----------------------------------------
generation_number = Input()
create = List.Create(getItemAtIndex, python_script, generation_number)
parent_vector = Output(create)
watch_2 = Watch(python_script)
watch_3 = Watch(combine)
watch_4 = Watch(code_block.out0)
watch_5 = Watch(list_of_parameters_and_ranges)
