# Dynamo custom node Mutate Parent Daylight.dyf (Dynamo 0.7.2.19034)
# category: Misc

parent = Input()
mutation_rate = Input()
number = DoubleInput(1)
# note: list of parameter pairs
getItemAtIndex = List.GetItemAtIndex(parent, number)
number_2 = DoubleInput(0)
# note: value
getItemAtIndex_2 = List.GetItemAtIndex(arg1=number_2)
map = List.Map(getItemAtIndex, getItemAtIndex_2)
count = List.Count(map)
randomList = Math.RandomList(count)
code_block = CodeBlock { 0; 1; }
code_block_2 = CodeBlock { -1; 1; }
mapTo = MapTo(code_block.out0, code_block.out1, arg3=code_block_2.out0, arg4=code_block_2.out1)
map_2 = List.Map(randomList, mapTo)
mul = mutation_rate * map_2  # lacing=Longest
paramaters_and_ranges = Input()
number_3 = DoubleInput(0)
# note: range values
getItemAtIndex_3 = List.GetItemAtIndex(arg1=number_3)
map_3 = List.Map(paramaters_and_ranges, getItemAtIndex_3)
# note: Add Random vectors and current state new state = randomnum * mutation rate * range
python_script = Python(IN[0]=parent, IN[1]=mul, IN[2]=map_3)
# ---------- python_script.python (38 lines) ----------
# Default imports
import clr
clr.AddReference('RevitAPI')
clr.AddReference('RevitAPIUI')
from Autodesk.Revit.DB import *
import Autodesk
import sys
import clr
path = r'C:\Autodesk\Dynamo\Core'
exec_path = r'C:\Autodesk\Dynamo\Core\dll'
sys.path.append(path)
sys.path.append(exec_path)
clr.AddReference('LibGNet')
from Autodesk.LibG import *
import math
#The input to this node will be stored in the IN[0]...INX variable(s).
parent = IN[0]
randomvector = IN[1]
ranges = IN[2]
paramlist = parent[1]

#for i in range(len(paramlist)):
#	paramlist[i][0] =  max(1,paramlist[i][0] + randomvector[i])

def clamp(n, minn, maxn):
    if n < minn:
        return minn
    elif n > maxn:
        return maxn
    else:
        return n

for i in range(len(paramlist)):
	range = ranges[i][1] - ranges[i][0]
	paramlist[i][0] = clamp( paramlist[i][0] + range*randomvector[i], ranges[i][0], ranges[i][1])

#Assign your output to the OUT variable
OUT = parent
# ----------------------------------------
family_instances = Input()
count_2 = List.Count(family_instances)
number_4 = DoubleInput(1)
sub = count_2 - number_4  # lacing=Longest
rand = Math.Rand()
mul_2 = sub * rand  # lacing=Longest
round = Math.Round(mul_2, lacing=Longest)
getItemAtIndex_4 = List.GetItemAtIndex(family_instances, round)
python_script_2 = Python(IN[0]=python_script, IN[1]=getItemAtIndex_4)
# ---------- python_script_2.python (23 lines) ----------
# Default imports
import clr
clr.AddReference('RevitAPI')
clr.AddReference('RevitAPIUI')
from Autodesk.Revit.DB import *
import Autodesk
import sys
import clr
path = r'C:\Autodesk\Dynamo\Core'
exec_path = r'C:\Autodesk\Dynamo\Core\dll'
sys.path.append(path)
sys.path.append(exec_path)
clr.AddReference('LibGNet')
from Autodesk.LibG import *

#The input to this node will be stored in the IN[0]...INX variable(s).
parent = IN[0]
fi = IN[1]

parent[0] = fi

#Assign your output to the OUT variable
OUT = parent
# ----------------------------------------
python_script_3 = Python(IN[0]=python_script_2)
# ---------- python_script_3.python (20 lines) ----------
# Default imports
import clr
clr.AddReference('RevitAPI')
clr.AddReference('RevitAPIUI')
from Autodesk.Revit.DB import *
import Autodesk
import sys
import clr
path = r'C:\Autodesk\Dynamo\Core'
exec_path = r'C:\Autodesk\Dynamo\Core\dll'
sys.path.append(path)
sys.path.append(exec_path)
clr.AddReference('LibGNet')
from Autodesk.LibG import *

#The input to this node will be stored in the IN[0] variable.
parent = IN[0]
parent[2] = parent[2] + 1
#Assign your output to the OUT variable
OUT = parent
# ----------------------------------------
mutated_parent = Output(python_script_3)
watch = Watch(python_script)
watch_2 = Watch(mul)
watch_3 = Watch(map_2)
watch_4 = Watch(randomList)
