# Dynamo graph Insolation Iteration Workflow WIP.dyn (Dynamo 0.7.2.37747)

create_list = List.Create()
code_block = CodeBlock { 40..90..40; }
string = StringInput("increment")
create_list_2 = List.Create(string)
cartesianProduct = List.CartesianProduct(create_list, code_block, create_list_2)
watch = Watch(cartesianProduct)
create_list_3 = List.Create()
family_types = FamilyTypes("BuildingMass_Loaded_5:SouthEast Plaza")
all_elements_of_family_type = ElementsOfFamilyType(family_types)
cartesianProduct_2 = List.CartesianProduct(create_list_3, all_elements_of_family_type, cartesianProduct)
code_block_2 = CodeBlock { 1; }
flatten = List.Flatten(cartesianProduct_2, code_block_2)
count = List.Count(flatten)
watch_2 = Watch(count)
flatten_2 = List.Flatten(arg1=code_block_2)
python_script = Python(IN[0]=flatten)
# ---------- python_script.python (8 lines) ----------
#The input to this node will be stored in the IN[0] variable.
listoflists= IN[0]

for i in range(len(listoflists)):
	list = listoflists[i]
	list.append(i)
#Assign your output to the OUT variable
OUT = listoflists
# ----------------------------------------
watch_3 = Watch(python_script)
solarupdateparameter_s = Custom[SolarUpdateParameter(s)]()  # [familyinstance, [parameter1,val][parameter2,val] iteration number]
select_model_element = DSModelElementSelection()  # 1 picked in the model
faces = Element.Faces(select_model_element)
file_path = Filename("C:\Users\Mike\AppData\Roaming\Dynamo\0.7\packages\Dynamo Solar Insolation\bin\WeatherData\USA-NewYorkNewYork.wea")
select_model_element_2 = DSModelElementSelection()  # 1 picked in the model
computeSolarinsolationFromSurfaces = Custom[ComputeSolarinsolationFromSurfaces](shading_surfaces=faces, weather_file_path=file_path, surfaces_to_analyze=select_model_element_2)  # comuteSolarInsolationFromSurfacesAndShades
compose = ComposeFunctions(solarupdateparameter_s, computeSolarinsolationFromSurfaces)  # "Function.Compose"
map = List.Map(watch_3, compose)
code_block_3 = CodeBlock(a=map) { a[0][2]; }
code_block_4 = CodeBlock(a=map) { a[1][2]; }
