# Dynamo custom node RandomAsFunction(min,max).dyf (Dynamo 0.7.2.19034)
# category: Math
# mappable2argrandom

code_block = CodeBlock { min; }
code_block_2 = CodeBlock { max; }
random = Math.Random(code_block, code_block_2)
double = Output(random)
code_block_3 = CodeBlock { x; }
