# Dynamo custom node RemapVal.dyf (Dynamo 0.7.2.19034)
# category: Misc

value_to_map = Input()
in_min = Input()
out_min = Input()
out_max = Input()
in_max = Input()
code_block = CodeBlock(x=value_to_map, in_min=in_min, out_max=out_min, out_min=out_max, in_max=in_max) { y =  (x - in_min) * (out_max - out_min) / (in_max - in_min) + out_min; }
