# Dynamo custom node RenderWithWeatherData_Return List of data.dyf (Dynamo 0.7.2.15588)
# category: Misc

code_block = CodeBlock { "{3D}"; }
export_cloud_render_data = ExportDocumentRenderData(code_block)
end = Revit.Transaction.Transaction.End(export_cloud_render_data)
upload_cloud_render_data = UploadRenderData(end)
xDivisions = Input()
bottom_left = Input()
bottom_right = Input()
top_left = Input()
skyModelType = SkyModelTypeDropDown("Perez")
weatherDataFilePath = Input()
code_block_2 = CodeBlock { 6; }
number = DoubleInput(16)
number_2 = DoubleInput(5)
byDateInformation = Analyze.Render.DateTime.ByDateInformation(code_block_2, arg3=number, arg6=number_2, lacing=Longest)
python_script = Python(IN[0]=weatherDataFilePath, IN[1]=byDateInformation)
# ---------- python_script.python (65 lines) ----------
# Default imports
import clr
import sys
sys.path.append(r'C:\Program Files (x86)\IronPython 2.7\Lib')
from System import DateTime
import csv
from System import Reflection
from System.Reflection import *
#The input to this node will be stored in the IN[0]...INX variable(s).
path = IN[0]
dateobject = IN[1]
property = dateobject.GetType().GetProperty("InternalDateTime",BindingFlags.Instance | BindingFlags.NonPublic | BindingFlags.Public)

dateobject = property.GetValue(dateobject, None);

monthform = 'MM'
dayform = 'dd'
hourform = 'HH'
month = dateobject.ToString(monthform)
day = dateobject.ToString(dayform)
hour = dateobject.ToString(hourform)


ifile  = open(path, "rb")

input_file = csv.reader(ifile)
rowlist = []
rownum = 0
for row in input_file:
    # ignore the first header - this file has two for some reason
    if rownum == 0:
      timeZoneOffset = row[4]
      timeZoneOffset = timeZoneOffset.split(':')[1]
      timeZoneOffset = int(timeZoneOffset)
      rownum += 1
      continue

     # Save header row.	
    if rownum == 1:
        header = row
    else:
        colnum = 0
        dict = {}
        for col in row:
           
           dict[header[colnum]] = col 
           rowlist.append(dict)
           colnum += 1
   
   #keep track of row we're at.         
    rownum += 1


ifile.close()

skydata = 0

localHour = str(int(hour) + timeZoneOffset).zfill(2)

for row in rowlist:
	if row[" Month"] == month and row[" Day"] == day and row[" Hour"] == localHour:
		skydata = (row[' GlobHorizRad (Wh/m2)'],row[' DirNormRad (Wh/m2)'],row['DiffHorizRad (Wh/m2)'])

#Assign your output to the OUT variable
OUT = skydata
# ----------------------------------------
toNumber = String.ToNumber(lacing=Longest)
map = List.Map(python_script, toNumber)
number_3 = DoubleInput(2)
getItemAtIndex = List.GetItemAtIndex(map, number_3)
number_4 = DoubleInput(1)
getItemAtIndex_2 = List.GetItemAtIndex(map, number_4)
number_5 = DoubleInput(0)
getItemAtIndex_3 = List.GetItemAtIndex(map, number_5)
byTypeConstants = Analyze.Render.SkyModel.ByTypeConstants(skyModelType, getItemAtIndex, getItemAtIndex_2, getItemAtIndex_3, lacing=Longest)
code_block_3 = CodeBlock { 40; }
code_block_4 = CodeBlock { -72; }
bySkyModelLocationDate = Analyze.Render.RenderingEnvironment.BySkyModelLocationDate(byTypeConstants, code_block_3, code_block_4, byDateInformation, lacing=Longest)
byViewNameDivisionsGridBoundary = Analyze.Daylighting.CloudDaylightingJob.ByViewNameDivisionsGridBoundary(code_block, xDivisions, xDivisions, bottom_left, bottom_right, top_left, bySkyModelLocationDate, lacing=Longest)
boolean = BoolSelector(false)
do_cloud_render = CloudRender(upload_cloud_render_data, byViewNameDivisionsGridBoundary, boolean)
firstItem = List.FirstItem(do_cloud_render)
parse = Analyze.Daylighting.DaylightingResults.Parse(firstItem, lacing=Longest)
double_slider = DoubleSlider(5000, range=0..120000)
toImage = Analyze.Daylighting.DaylightingResults.ToImage(parse, double_slider, lacing=Longest)
watch_image = WatchImageCore(toImage)
colors = Analyze.Daylighting.DaylightingResults.Colors(parse, double_slider, lacing=Longest)
illuminanceValues = Analyze.Daylighting.DaylightingResults.IlluminanceValues(parse, lacing=Longest)
toSRGB = Analyze.Daylighting.Illuminance.ToSRGB(illuminanceValues, lacing=Longest)
resolution = Analyze.Daylighting.DaylightingResults.Resolution(parse, lacing=Longest)
iteration = Input()
points = Analyze.Daylighting.DaylightingResults.Points(parse, lacing=Longest)
create_list = List.Create(toImage, colors, illuminanceValues, toSRGB, resolution, iteration, points)
Render_Data = Output(create_list)
watch = Watch(create_list)
watch_image_2 = WatchImageCore(toImage)
watch_2 = Watch(firstItem)
watch_3 = Watch(python_script)
watch_4 = Watch(byViewNameDivisionsGridBoundary)
