# Dynamo custom node ComputeSolarinsolationFromSurfaces.dyf (Dynamo 0.7.2.37747)
# category: Analyze.Solar Insolation.SolarInsolation.Create
# comuteSolarInsolationFromSurfacesAndShades

iteration = Input()
weather_file_path = Input()
fromFile = DynamoSolarInsolation.Wrappers.Weather.FromFile(weather_file_path)
surfaces_to_analyze = Input()
faces = Element.Faces(surfaces_to_analyze)
flatten = Flatten(faces)
number = DoubleInput(0)
number_2 = DoubleInput(1)
number_3 = DoubleInput(0.1)
number_range = NumberRange(number, number_2, number_3, lacing=Longest)
byCoordinates = UV.ByCoordinates(number_range, number_range, lacing=CrossProduct)
flatten_2 = Flatten(byCoordinates)
count = List.Count(flatten)
ofRepeatedItem = List.OfRepeatedItem(flatten_2, count)
surfaceAnalysisData = Analysis.DataTypes.SurfaceAnalysisData.SurfaceAnalysisData(flatten, ofRepeatedItem)
shading_surfaces = Input()
flatten_3 = Flatten(shading_surfaces)
current = SunSettings()  # "SunSettings.Current"
analyze = DynamoSolarInsolation.Wrappers.SolarInsolation.Analyze(fromFile, surfaceAnalysisData, flatten_3, current)
results = DynamoSolarInsolation.Wrappers.SolarInsolation.Results(analyze)
results_2 = Analysis.DataTypes.SurfaceAnalysisData.Results(results)
pointAtParameter = Surface.PointAtParameter(lacing=Longest)
surface = Analysis.DataTypes.SurfaceAnalysisData.Surface(surfaceAnalysisData)
calculationLocations = Analysis.DataTypes.SurfaceAnalysisData.CalculationLocations(surfaceAnalysisData)
U = UV.U(calculationLocations)
V = UV.V(calculationLocations)
laceLongest = List.LaceLongest(pointAtParameter, surface, U, V)
create = List.Create(iteration, results_2, laceLongest)
data_iteration_locations = Output(create)  # "data,iteration,locations"
current_2 = Document.Current()
activeView = Document.ActiveView(current_2)
string = StringInput("Solar Insolation Ninjitsu")
string_2 = StringInput("Some seriously cool calculations from Dynamo.")
unit_types = UnitTypes("Insolation")
byViewAndFaceAnalysisData = Revit.AnalysisDisplay.FaceAnalysisDisplay.ByViewAndFaceAnalysisData(activeView, results, string, string_2, unit_types)
end = Revit.Transaction.Transaction.End(byViewAndFaceAnalysisData)
