# Dynamo custom node SolarUpdateParameter(s).dyf (Dynamo 0.7.2.28181)
# category: Misc
# [familyinstance, [parameter1,val][parameter2,val] iteration number]

seq = Input()
# note: iteration number
lastItem = List.LastItem(seq)
iteration_num = Output(lastItem)
# note: family instance
firstItem = List.FirstItem(seq)
watch = Watch(firstItem)
python_script = Python(IN[0]=seq)
# ---------- python_script.python (10 lines) ----------
#The input to this node will be stored in the IN[0] variable.
ArgList = IN[0]

listOfLists = []

for item in ArgList:
		if hasattr(item,'__iter__'):
			listOfLists.append(item)
OUT = listOfLists
	
# ----------------------------------------
number = DoubleInput(1)
flatten = List.Flatten(python_script, number)
watch_2 = Watch(flatten)
# note: parameter name
lastItem_2 = List.LastItem()
map = List.Map(watch_2, lastItem_2)
watch_3 = Watch(map)
# note: value
firstItem_2 = List.FirstItem()
map_2 = List.Map(flatten, firstItem_2)
watch_4 = Watch(map_2)
setParameterByName = Element.SetParameterByName(watch, watch_3, watch_4, lacing=Longest)
end = Revit.Transaction.Transaction.End(setParameterByName)
