# Dynamo graph Brute Forcing Parameters and Rendering_facades_Plus.dyn (Dynamo 0.7.2.15588)

# note: this will wrap a parameter and its values into a tuple.. we can make this a function and map it to ranges of values and their associated parameters...
number = DoubleInput(1..8..3)
watch = Watch(number)
number_2 = DoubleInput(0.4)
watch_2 = Watch(number_2)
create_list = List.Create()
create_list_2 = List.Create()
string = StringInput("spandrel_dist")
create_list_3 = List.Create(string)
cartesianProduct = List.CartesianProduct(create_list_2, number_2, create_list_3)
code_block = CodeBlock { 1; }
flatten = List.Flatten(cartesianProduct, code_block)
create_list_4 = List.Create()
string_2 = StringInput("fin_size_multiplier")
create_list_5 = List.Create(string_2)
cartesianProduct_2 = List.CartesianProduct(create_list_4, number, create_list_5)
flatten_2 = List.Flatten(cartesianProduct_2, code_block)
cartesianProduct_3 = List.CartesianProduct(create_list, flatten, flatten_2)
watch_3 = Watch(cartesianProduct_3)
create_list_6 = List.Create()
family_types = FamilyTypes("curtain panel AC with spandrel:curtain panel AC with spandrel")
create_list_7 = List.Create(family_types)
flatten_3 = List.Flatten(cartesianProduct_3, code_block)
cartesianProduct_4 = List.CartesianProduct(create_list_6, create_list_7, flatten_3)
flatten_4 = List.Flatten(cartesianProduct_4, code_block)
count = List.Count(flatten_4)
watch_4 = Watch(count)
python_script = Python(IN[0]=flatten_4)
# ---------- python_script.python (8 lines) ----------
#The input to this node will be stored in the IN[0] variable.
listoflists= IN[0]

for i in range(len(listoflists)):
	list = listoflists[i]
	list.append(i)
#Assign your output to the OUT variable
OUT = listoflists
# ----------------------------------------
watch_5 = Watch(python_script)
# note: This Function updates the parameters before starting a rendering - mapping over the sequence below - FORMAT IS:
# [family instance, [param01,val][param02...,val]iteraton]
updateparameter_s = Custom[UpdateParameter(s)]()  # [familyinstance, [parameter1,val][parameter2,val] iteration number]
file_path = Filename("\\psf\Dropbox\Autodesk Fall 2014\Facades + October\Dynamo-63FacadesPlus\doc\distrib\Samples\25 Rendering\GBS_04R20_266135.csv")
number_3 = DoubleInput(356)
number_4 = DoubleInput(-793)
number_5 = DoubleInput(45)
byCoordinates = Point.ByCoordinates(number_3, number_4, number_5, lacing=Longest)
code_block_2 = CodeBlock { 150; }
number_6 = DoubleInput(96)
number_7 = DoubleInput(-643)
byCoordinates_2 = Point.ByCoordinates(number_6, number_7, number_5, lacing=Longest)
number_8 = DoubleInput(246)
number_9 = DoubleInput(-384)
byCoordinates_3 = Point.ByCoordinates(number_8, number_9, number_5, lacing=Longest)
renderwithweatherdata_return = Custom[RenderWithWeatherData_Return List of data](weatherDataFilePath=file_path, bottom_right=byCoordinates, xDivisions=code_block_2, bottom_left=byCoordinates_2, top_left=byCoordinates_3)
# note: extract some data from render and save an image of the extracted bitmap.  We use python to get he sample folder to save the images in
directory_path = Directory("C:\Users\Mike\Desktop")
getDataFromRender_WriteImage = Custom[GetDataFromRender_WriteImage](filePath=directory_path)
compose = ComposeFunctions(updateparameter_s, renderwithweatherdata_return, getDataFromRender_WriteImage)  # "Function.Compose"
map = List.Map(watch_5, compose)
