# Dynamo graph Brute Forcing Parameters and Rendering.dyn (Dynamo 0.7.2.14456)

# note: This wraps up the data for us to use... but it is not the function that unrwaps it and applies it
create_list = List.Create()
# note: associated revit file in sample folder where this graph was found
# note: Note that this graph execution will take some time as it alternates between updating revit parameters and sending off 24 renderings
family_types = FamilyTypes("curtain panel AC with spandrel:curtain panel AC with spandrel")
create_list_2 = List.Create()
create_list_3 = List.Create()
number = DoubleInput(5..20..10)
string = StringInput("Width")
create_list_4 = List.Create(string)
longest = LaceLongest(create_list_3, number, create_list_4)  # "List.Longest"
# note: this will wrap a parameter and its values into a tuple.. we can make this a function and map it to ranges of values and their associated parameters...
create = List.Create()
code_block = CodeBlock { {"Height"}; }
number_2 = DoubleInput(10..20..10)
longest_2 = LaceLongest(create, code_block, number_2)  # "List.Longest"
longest_3 = LaceLongest(create_list_2, longest, longest_2)  # "List.Longest"
cartesianProduct = List.CartesianProduct(create_list, family_types, longest_3)
count = List.Count(cartesianProduct)
code_block_2 = CodeBlock(a=cartesianProduct) { a[0]; }
python_script = Python(IN[0]=code_block_2)
# ---------- python_script.python (8 lines) ----------
#The input to this node will be stored in the IN[0] variable.
listoflists= IN[0]

for i in range(len(listoflists)):
	list = listoflists[i]
	list.append(i)
#Assign your output to the OUT variable
OUT = listoflists
# ----------------------------------------
watch = Watch(python_script)
