# Dynamo graph hill_climbing_daylighting_FacadesPlus.7.dyn (Dynamo 0.7.2.19034)

number = DoubleInput(0.05)
number_2 = DoubleInput(0.45)
create_list = List.Create(number, number_2)
string = StringInput("spandrel_dist")
create_list_2 = List.Create(create_list, string)
number_3 = DoubleInput(1)
number_4 = DoubleInput(7)
create_list_3 = List.Create(number_3, number_4)
string_2 = StringInput("fin_size_multiplier")
create_list_4 = List.Create(create_list_3, string_2)
number_5 = DoubleInput(0.5)
number_6 = DoubleInput(1)
create_list_5 = List.Create(number_5, number_6)
string_3 = StringInput("frame_size")
create_list_6 = List.Create(create_list_5, string_3)
create_list_7 = List.Create(create_list_2, create_list_4, create_list_6)
watch = Watch(create_list_7)
number_7 = DoubleInput(0)
family_types = FamilyTypes(index=7)
create_list_8 = List.Create(family_types)
make_daylight_param_parent = Custom[Make Daylight param parent vector](list_of_parameters_and_ranges=create_list_7, generation_number=number_7, list_of_family_instances=create_list_8)
watch_2 = Watch(make_daylight_param_parent)
code_block = CodeBlock { 1; }
mutate_parent_daylight = Custom[Mutate Parent Daylight](family_instances=create_list_8, parent=make_daylight_param_parent, mutation_rate=code_block, paramaters_and_ranges=create_list_7)
randomasfunction = Custom[RandomAsFunction()](x=make_daylight_param_parent)  # MappableRandom()
